# Grasshopper definition tweetLandscape.ghx (Grasshopper 0.9.76)
# plug-ins: ghJSON

tweet_count_per_hash_x = Slider(10, range=0..10)
tweet_count_per_hash_y = Slider(10, range=0..10)
file_path = Panel("D:\Dropbox\Jose Luis\Twipology\10 - DEV\twipology\tweetData\1425256368597_tweets_parsed.json")
hash_count_x = Slider(4, range=0..10)
hash_count_y = Slider(3, range=0..10)
tweet_base_height_mm = Slider(10, range=0..100)
tweet_size_x_mm = Slider(100, range=0..500)
tweet_size_y_mm = Slider(150, range=0..500)
dam = DataDam(DataA=file_path, BufferDelay=20000000, BufferMode=2)

file = ReadFile(File=dam, PerLineParse=False)
txt = Text(file)

# ----
# USING ghJSON FOR GH:
# http://mathrioshka.ru/ghjson/
panel = Panel("{\"hashArray\":")
concat = Concatenate(FragmentA=panel, FragmentB=txt, FragmentC="}")
frmjson = FromJSON(JSON=concat)

jpath = JSONPath(JObject=frmjson, JSONPathQuery="$.hashArray[*].hashtag")
hashtags = Text(simplify(graft(jpath)))

lng = ListLength(List=hashtags)
series = Series(Start=0, Step=1, Count=lng)
int = Integer(series)

concat_2 = Concatenate(FragmentA="$.hashArray[", FragmentB=int, FragmentC="].tweets[*].text_length")
jpath_2 = JSONPath(JObject=frmjson, JSONPathQuery=concat_2)
tweet_length = Integer(simplify(jpath_2))

concat_3 = Concatenate(FragmentA="$.hashArray[", FragmentB=int, FragmentC="].tweets[*].word_count")
jpath_3 = JSONPath(JObject=frmjson, JSONPathQuery=concat_3)
tweet_word_count = Integer(simplify(jpath_3))

jpath_4 = JSONPath(JObject=frmjson, JSONPathQuery="$.hashArray[*].tweets[*].chars[*]")
flatten = FlattenTree(Tree=tweet_word_count, Path="{0}")
ma = MassAddition(Input=flatten)  # -> Result, PartialResults
int_2 = Integer(jpath_4)
shift = ShiftList(List=flatten(["0", ma.PartialResults]), Shift="-1", Wrap=False)  # -> flatten(List)
subtraction = Subtraction(A=ma.PartialResults, B="1")
graft = GraftTree(Tree=shift, IncludeEmptyLists=True, IncludeNullItems=True)  # -> simplify(Tree)
graft_2 = GraftTree(Tree=subtraction, IncludeEmptyLists=True, IncludeNullItems=True)  # -> simplify(Tree)
dom = ConstructDomain(DomainStart=graft, DomainEnd=graft_2)
flatten_2 = FlattenTree(Tree=dom, Path="{0}")
unflatten = UnflattenTree(Tree=flatten_2, Guide=tweet_word_count)
subset = SubList(List=int_2, Domain=unflatten, Wrap=False)  # -> List, Index
tweet_word_chars = Integer(simplify(subset.List))

concat_4 = Concatenate(FragmentA="$.hashArray[", FragmentB=int, FragmentC="].tweets[*].text")
jpath_5 = JSONPath(JObject=frmjson, JSONPathQuery=concat_4)
tweet_text = Text(simplify(jpath_5))

panel_2 = Panel(jpath)
panel_3 = Panel(tweet_word_chars)
c_script = CSharpScript(
    HashCountX=hash_count_x,
    HashCounty=hash_count_y,
    TweetCountHashX=tweet_count_per_hash_x,
    TweetCountHashY=tweet_count_per_hash_y,
    TweetSizeX=tweet_size_x_mm,
    TweetSizeY=tweet_size_y_mm,
    TweetBaseHeight=tweet_base_height_mm,
    Hashtags=hashtags,
    TweetLengths=tweet_length,
    TweetWords=tweet_word_count,
    TweetChars=tweet_word_chars)  # -> Out, A
